# Grasshopper definition gh_node_extractor.gh (Grasshopper 1.0.4)

geo = Geometry(<brep referenced from the Rhino model>)
crv = Curve([<curve referenced from the Rhino model> x816])
geo_2 = Geometry([<point referenced from the Rhino model> x97])
geo_3 = Geometry([<point referenced from the Rhino model> x28])
pdecon = Deconstruct(Point=geo_3)  # -> XComponent, YComponent, ZComponent
geo_4 = Geometry([<curve referenced from the Rhino model> x100])
geo_5 = Geometry([<point referenced from the Rhino model> x98])
geo_6 = Geometry([<curve referenced from the Rhino model> x435])
pt = ConstructPoint(XCoordinate=pdecon.XComponent, YCoordinate=pdecon.YComponent, ZCoordinate=-10000)
srf_cp = SurfaceClosestPoint(Point=geo_2, Surface=geo)  # -> Point, UVPoint, Distance
cullpt = CullDuplicates(Points=geo_3, Tolerance=0.1, CullMode=3)  # -> Points, Indices, Valence
pdecon_2 = Deconstruct(Point=geo_5)  # -> XComponent, YComponent, ZComponent
explode = Explode(Curve=geo_6, Recursive=True)  # -> Segments, Vertices
end = EndPoints(Curve=geo_4)  # -> Start, End
cullpt_2 = CullDuplicates(Points=pt, Tolerance=0.1, CullMode=3)  # -> Points, Indices, Valence
end_2 = EndPoints(Curve=crv)  # -> Start, End
pt_2 = ConstructPoint(XCoordinate=pdecon_2.XComponent, YCoordinate=pdecon_2.YComponent, ZCoordinate=-10000)
evalsrf = EvaluateSurface(Surface=geo, Point=srf_cp.UVPoint)  # -> Point, Normal, Frame
end_3 = EndPoints(Curve=flatten(explode.Segments))  # -> Start, End
merge = Merge(Data1=end.Start, Data2=end.End)  # -> flatten(Result)
multiplication = Multiplication(A=evalsrf.Normal, B=100)
merge_2 = Merge(Data1=end_3.Start, Data2=end_3.End)  # -> flatten(Result)
ln = Line(StartPoint=geo_5, EndPoint=pt_2)
merge_3 = Merge(Data1=end_2.Start, Data2=end_2.End, Data3=cullpt_2.Points)  # -> flatten(Result)
move = Move(Geometry=evalsrf.Point, Motion=multiplication)  # -> Geometry, Transform
cullpt_3 = CullDuplicates(Points=merge_2, Tolerance=100, CullMode=3)  # -> Points, Indices, Valence
merge_4 = Merge(Data1=cullpt_3.Points, Data2=pt_2)  # -> flatten(Result)
cullpt_4 = CullDuplicates(Points=merge_3, Tolerance=0.1, CullMode=3)  # -> Points, Indices, Valence
larger = LargerThan(FirstNumber=cullpt_4.Valence, SecondNumber=6)  # -> LargerThan, OrEqualTo
cp = ClosestPoint(Point=cullpt_2.Points, Cloud=cullpt_4.Points)  # -> ClosestPoint, CPIndex, Distance
cp_2 = ClosestPoint(Point=merge, Cloud=cullpt_4.Points)  # -> ClosestPoint, CPIndex, Distance
cp_3 = ClosestPoint(Point=end_2.Start, Cloud=cullpt_4.Points)  # -> ClosestPoint, CPIndex, Distance
cp_4 = ClosestPoint(Point=end_2.End, Cloud=cullpt_4.Points)  # -> ClosestPoint, CPIndex, Distance
cullpt_5 = CullDuplicates(Points=merge_4, Tolerance=0.1, CullMode=3)  # -> Points, Indices, Valence
cp_5 = ClosestPoint(Point=evalsrf.Point, Cloud=cullpt_5.Points)  # -> ClosestPoint, CPIndex, Distance
cp_6 = ClosestPoint(Point=cullpt.Points, Cloud=cullpt_4.Points)  # -> ClosestPoint, CPIndex, Distance
entwine = Entwine(Branch00=evalsrf.Normal, Branch01=cp_5.CPIndex, FlattenInputs=True)
flip = FlipMatrix(Data=entwine)
vec2pt = Vector2Pt(PointA=end.Start, PointB=end.End, Unitize=True)  # -> Vector, Length
dispatch = Dispatch(List=cullpt_4.Points, DispatchPattern=larger.OrEqualTo)  # -> ListA, ListB
Z = UnitZ(Factor=-1)
cp_7 = ClosestPoint(Point=end_3.Start, Cloud=cullpt_5.Points)  # -> ClosestPoint, CPIndex, Distance
cp_8 = ClosestPoint(Point=end_3.End, Cloud=cullpt_5.Points)  # -> ClosestPoint, CPIndex, Distance
entwine_2 = Entwine(Branch00=cp_3.CPIndex, Branch01=cp_4.CPIndex, FlattenInputs=True)
smaller = SmallerThan(FirstNumber=cp_2.Distance, SecondNumber=1)  # -> SmallerThan, OrEqualTo
cp_9 = ClosestPoint(Point=pt_2, Cloud=cullpt_5.Points)  # -> ClosestPoint, CPIndex, Distance
cp_10 = ClosestPoint(Point=geo_5, Cloud=cullpt_5.Points)  # -> ClosestPoint, CPIndex, Distance
entwine_3 = Entwine(Branch00=cp_6.CPIndex, Branch01=cp.CPIndex, FlattenInputs=True)
pt_3 = Point(dispatch.ListA)
dispatch_2 = Dispatch(List=cp_2.CPIndex, DispatchPattern=smaller.SmallerThan)  # -> ListA, ListB
crossref = CrossReference(ListA=Z, ListB=cp_6.CPIndex, CrossMode=1)  # -> ListA, ListB
entwine_4 = Entwine(Branch00=cp_7.CPIndex, Branch01=cp_8.CPIndex, FlattenInputs=True)
panel = Panel(cp_9.CPIndex)
entwine_5 = Entwine(Branch00=cp_10.CPIndex, Branch01=cp_9.CPIndex, FlattenInputs=True)
flip_2 = FlipMatrix(Data=entwine_2)
flip_3 = FlipMatrix(Data=entwine_3)
flip_4 = FlipMatrix(Data=entwine_5)
entwine_6 = Entwine(Branch00=crossref.ListA, Branch01=crossref.ListB, FlattenInputs=True)
graft = GraftTree(Tree=entwine_6, IncludeEmptyLists=True, IncludeNullItems=True)
num2pt = NumbersToPoints(Numbers=flatten(flip_2), Mask=2)
panel_2 = Panel(cullpt_5.Points)
entwine_7 = Entwine(Branch00=vec2pt.Vector, Branch01=dispatch_2.ListA, FlattenInputs=True)
num2pt_2 = NumbersToPoints(Numbers=flatten(flip_4), Mask=2)
panel_3 = Panel(flip)
merge_5 = Merge(Data1=Z, Data2=cp_6.CPIndex)
num2pt_3 = NumbersToPoints(Numbers=flatten(flip_3), Mask=2)
flip_5 = FlipMatrix(Data=entwine_4)
flip_6 = FlipMatrix(Data=entwine_6)
panel_4 = Panel(num2pt)
num2pt_4 = NumbersToPoints(Numbers=flatten(flip_5), Mask=2)
flip_7 = FlipMatrix(Data=entwine_7)
panel_5 = Panel(num2pt_3)
panel_6 = Panel(num2pt_2)
panel_7 = Panel(cullpt_4.Points)
panel_8 = Panel(cp.CPIndex)
panel_9 = Panel(num2pt_4)
panel_10 = Panel(flip_7)
